# Grasshopper definition UnconventionalDatasets.gh (Grasshopper 1.0.7)
# plug-ins: Human UI, Human, MetaHopper, Telepathy

# ---- group: creating NBBJ header
# Setting up the Header
number_slider = Slider(16, range=0..100)
path = FilePath("C:\Users\gupta\Desktop\My Cloud Offline Files\Computation\Hackathons\AEC Tech 2019\rhino-data-drive\Assets\Sparrow_Logo.png")
concat = Concatenate(FragmentA="SPARROW", FragmentB="- making complex datasets accessible")
genes = GenePool(Decimals=2, Maximum=120, Minimum=-80, Value=[-18.87, -8.26, 6.14, 3.79])
relpath = RelativePath(Path=path)
genes_2 = GenePool(Decimals=2, Maximum=120, Minimum=-80, Value=[-28.95, -11.63, -80, -9.67])
label = CreateLabel(LabelText=concat, LabelSize=number_slider, Justification=0)
image = CreateImage(ImageSource=relpath, ImageWidth=Slider(90, range=0..450))
join = TextJoin(Text=genes, Join=",")
join_2 = TextJoin(Text=genes_2, Join=",")
adjustpos = AdjustElementPositioning(ElementsToAdjust=label, Margin=join, AbsolutePositioning=False)
adjustpos_2 = AdjustElementPositioning(ElementsToAdjust=image, Margin=join_2, AbsolutePositioning=False)
merge = Merge(Data1=image, Data2=label)
stack = CreateStack(UIElements=merge, Horizontal=False)
adjustpos_3 = AdjustElementPositioning(ElementsToAdjust=stack, Margin=Slider(20, range=0..100), AbsolutePositioning=False, HorizontalAlignment=1)
hui_header = RemoteSender(stack)

# ----
panel = Panel("""Value: Refers to data that has a single key and value input.

Discrete: Refers to data that has multiple keys and values. For example, the break down of land use in a block.

Temporal: Data that shows changes through time variable. Example, change in population density.""")
label_2 = CreateLabel(LabelText=" ", LabelSize=Slider(1, range=0..24), Justification=0)
radiobtn = CreateRadioButton(RadioButtonName="Value", RadioButtonGroup="datatype2", InitiallySelected=False)
radiobtn_2 = CreateRadioButton(RadioButtonName="Discrete", RadioButtonGroup="datatype2", InitiallySelected=False)
label_3 = CreateLabel(LabelText="Select Data Type", LabelSize=12, Justification=0)
radiobtn_3 = CreateRadioButton(RadioButtonName="Temporal", RadioButtonGroup="datatype2", InitiallySelected=False)
merge_2 = Merge(Data1=label_2, Data2=label_3, Data3=radiobtn, Data4=radiobtn_2, Data5=radiobtn_3)
values = ValueListener(Elements=[radiobtn, radiobtn_2, radiobtn_3], SomeProperty=True)  # -> Values, Indices
tooltip = AttachTooltipToElement(ElementsToAttachTo=[radiobtn, radiobtn_2, radiobtn_3], TooltipContent=panel, ShowDelay=100, Duration=2000)
hui_dv_datatype = RemoteSender(merge_2)

panel_2 = Panel("Temporal")  # disabled
radiobtn_4 = CreateRadioButton(RadioButtonName="3D", RadioButtonGroup="vis_cont2", InitiallySelected=False)
radiobtn_5 = CreateRadioButton(RadioButtonName="Gradient", RadioButtonGroup="vis_cont2", InitiallySelected=False)
radiobtn_6 = CreateRadioButton(RadioButtonName=panel_2, RadioButtonGroup="vis_cont2", InitiallySelected=False)  # disabled
values_2 = ValueListener(Elements=[radiobtn_4, radiobtn_5, radiobtn_6], SomeProperty=True)  # -> Values, Indices
merge_3 = Merge(Data1=radiobtn_4, Data2=radiobtn_5, Data3=radiobtn_6)
python = GhPythonScript(continuous=flatten(values_2.Values))  # -> out, visualisation; inputs continuous: list
# ---------- python: Python ----------
__author__ = "gupta"
__version__ = "2019.10.19"

if continuous[0] == True:
    visualisation = "extrude"
else: visualisation = "gradient"
# ---------- end python ----------
item = ListItem(List=flatten(values.Values), Index=0, Wrap=True)  # disabled
in_iv_vis_style = RemoteSender(python.visualisation)
hideshow = HideShowElement(ElementToHideShow=merge_3, Show=item, Collapse=True, Disable=False)  # disabled

panel_3 = Panel("vis_cont")  # disabled
panel_4 = Panel("Gradient")  # disabled
panel_5 = Panel("Stacked")  # disabled
panel_6 = Panel("Temporal")  # disabled
radiobtn_7 = CreateRadioButton(RadioButtonName=panel_5, RadioButtonGroup=panel_3, InitiallySelected=False)  # disabled
radiobtn_8 = CreateRadioButton(RadioButtonName=panel_4, RadioButtonGroup=panel_3, InitiallySelected=False)  # disabled
radiobtn_9 = CreateRadioButton(RadioButtonName=panel_6, RadioButtonGroup=panel_3, InitiallySelected=False)  # disabled
values_3 = ValueListener(Elements=[radiobtn_7, radiobtn_8, radiobtn_9], SomeProperty=True)  # -> Values, Indices; disabled
merge_4 = Merge(Data1=radiobtn_8, Data2=radiobtn_7, Data3=radiobtn_9)  # disabled
python_2 = GhPythonScript(continuous=flatten(values_3.Values))  # -> out, visualisation; inputs continuous: list; disabled; same code as python
item_2 = ListItem(List=flatten(values.Values), Index=1, Wrap=True)  # disabled
in_iv_vis_style_2 = RemoteSender(python_2.visualisation)  # disabled
hideshow_2 = HideShowElement(ElementToHideShow=merge_4, Show=item_2, Collapse=True, Disable=False)  # disabled

label_4 = CreateLabel(LabelText=" ", LabelSize=Slider(1, range=0..24), Justification=0)
label_5 = CreateLabel(LabelText="Select Visualisation", LabelSize=12, Justification=0)
merge_5 = Merge(Data1=label_4, Data2=label_5)

label_6 = CreateLabel(LabelText=" ", LabelSize=Slider(1, range=0..24), Justification=0)
label_7 = CreateLabel(LabelText="Select Visualisation", LabelSize=12, Justification=0)
merge_6 = Merge(Data1=label_6, Data2=label_7)

label_8 = CreateLabel(LabelText=" ", LabelSize=Slider(1, range=0..24), Justification=0)

# ----
# Selecting the Type of Value Input
panel_7 = Panel("Select Data Type")
panel_8 = Panel("""Value: Refers to data that has a single key and value input.

Discrete: Refers to data that has multiple keys and values. For example, the break down of land use in a block.

Temporal: Data that shows changes through time variable. Example, change in population density.""")
radiobtn_10 = CreateRadioButton(RadioButtonName="Value", RadioButtonGroup="datatype", InitiallySelected=False)
radiobtn_11 = CreateRadioButton(RadioButtonName="Discrete", RadioButtonGroup="datatype", InitiallySelected=False)
label_9 = CreateLabel(LabelText=panel_7, LabelSize=12, Justification=0)
radiobtn_12 = CreateRadioButton(RadioButtonName="Temporal", RadioButtonGroup="datatype", InitiallySelected=False)
merge_7 = Merge(Data1=label_8, Data2=label_9, Data3=radiobtn_10, Data4=radiobtn_11, Data5=radiobtn_12)
values_4 = ValueListener(Elements=[radiobtn_10, radiobtn_11, radiobtn_12], SomeProperty=True)  # -> Values, Indices
tooltip_2 = AttachTooltipToElement(ElementsToAttachTo=[radiobtn_10, radiobtn_11, radiobtn_12], TooltipContent=panel_8, ShowDelay=100, Duration=2000)
hui_iv_datatype = RemoteSender(merge_7)

panel_9 = Panel("Temporal")  # disabled
radiobtn_13 = CreateRadioButton(RadioButtonName="3D", RadioButtonGroup="vis_cont", InitiallySelected=False)
radiobtn_14 = CreateRadioButton(RadioButtonName="Gradient", RadioButtonGroup="vis_cont", InitiallySelected=False)
radiobtn_15 = CreateRadioButton(RadioButtonName=panel_9, RadioButtonGroup="vis_cont", InitiallySelected=False)  # disabled
values_5 = ValueListener(Elements=[radiobtn_13, radiobtn_14, radiobtn_15], SomeProperty=True)  # -> Values, Indices
merge_8 = Merge(Data1=radiobtn_13, Data2=radiobtn_14, Data3=radiobtn_15)
python_3 = GhPythonScript(continuous=flatten(values_5.Values))  # -> out, visualisation; inputs continuous: list; same code as python
item_3 = ListItem(List=flatten(values_4.Values), Index=0, Wrap=True)  # disabled
in_iv_vis_style_3 = RemoteSender(python_3.visualisation)
hideshow_3 = HideShowElement(ElementToHideShow=merge_8, Show=item_3, Collapse=True, Disable=False)  # disabled

panel_10 = Panel("vis_cont")  # disabled
panel_11 = Panel("Gradient")  # disabled
panel_12 = Panel("Stacked")  # disabled
panel_13 = Panel("Temporal")  # disabled
radiobtn_16 = CreateRadioButton(RadioButtonName=panel_12, RadioButtonGroup=panel_10, InitiallySelected=False)  # disabled
radiobtn_17 = CreateRadioButton(RadioButtonName=panel_11, RadioButtonGroup=panel_10, InitiallySelected=False)  # disabled
radiobtn_18 = CreateRadioButton(RadioButtonName=panel_13, RadioButtonGroup=panel_10, InitiallySelected=False)  # disabled
values_6 = ValueListener(Elements=[radiobtn_16, radiobtn_17, radiobtn_18], SomeProperty=True)  # -> Values, Indices; disabled
merge_9 = Merge(Data1=radiobtn_17, Data2=radiobtn_16, Data3=radiobtn_18)  # disabled
python_4 = GhPythonScript(continuous=flatten(values_6.Values))  # -> out, visualisation; inputs continuous: list; disabled; same code as python
item_4 = ListItem(List=flatten(values_4.Values), Index=1, Wrap=True)  # disabled
in_iv_vis_style_4 = RemoteSender(python_4.visualisation)  # disabled
hideshow_4 = HideShowElement(ElementToHideShow=merge_9, Show=item_4, Collapse=True, Disable=False)  # disabled

# ----
# Selecting the Visualisation Style
hui_dv_vizlabel = RemoteSender(merge_5)
hui_dv_vizvalue = RemoteSender(merge_3)
hui_dv_vizvdiscrete = RemoteSender(merge_4)  # disabled

gradient = Gradient(LowerLimit=0, UpperLimit=1, stops=[0.15: RGB(255, 130, 160), 0.85: RGB(220, 0, 40)])

# ----
# Selecting the Visualisation Style
hui_iv_vizlabel = RemoteSender(merge_6)
hui_iv_vizvalue = RemoteSender(merge_8)
hui_iv_vizvdiscrete = RemoteSender(merge_9)  # disabled

max_height = Slider(117, range=0..500)
slider = CreateSlider(Slider=max_height, ShowBounds=False, ShowTicks=False, ShowTooltip=False, ShowValLabel=True, showLabel=True)
item_5 = ListItem(List=flatten(values_2.Values), Index=0, Wrap=True)
values_7 = ValueListener(Elements=slider, SomeProperty=True)  # -> Values, Indices
hideshow_5 = HideShowElement(ElementToHideShow=slider, Show=item_5, Collapse=True, Disable=False)

gradient_2 = CreateGradientEditor(ShowEditor=True, ShowPresets=False)

max_height_2 = Slider(117, range=0..500)
slider_2 = CreateSlider(Slider=max_height_2, ShowBounds=False, ShowTicks=False, ShowTooltip=False, ShowValLabel=True, showLabel=True)
item_6 = ListItem(List=flatten(values_5.Values), Index=0, Wrap=True)
values_8 = ValueListener(Elements=slider_2, SomeProperty=True)  # -> Values, Indices
hideshow_6 = HideShowElement(ElementToHideShow=slider_2, Show=item_6, Collapse=True, Disable=False)

panel_14 = Panel(values_4.Values)
hui_iv_valuegrad = RemoteSender(gradient_2)
hui_dv_valueheight = RemoteSender(values_7.Values)
hui_iv_valueheight = RemoteSender(slider_2)
hui_iv_valueheight_2 = RemoteReceiver(hui_iv_valueheight)
hui_iv_valuegrad_2 = RemoteReceiver(hui_iv_valuegrad)
hui_dv_vizvdiscrete_2 = RemoteReceiver(hui_dv_vizvdiscrete)
hui_iv_vizvalue_2 = RemoteReceiver(hui_iv_vizvalue)
hui_dv_vizvalue_2 = RemoteReceiver(hui_dv_vizvalue)
hui_dv_datatype_2 = RemoteReceiver(hui_dv_datatype)
hui_dv_vizlabel_2 = RemoteReceiver(hui_dv_vizlabel)
hui_iv_vizlabel_2 = RemoteReceiver(hui_iv_vizlabel)
toggle = BooleanToggle(True)
in_iv_vis_style_5 = RemoteReceiver([in_iv_vis_style_3, in_iv_vis_style_4, in_iv_vis_style, in_iv_vis_style_2])
layertable = LayerTable(Update=Toggle(True), AutoUpdate=False)  # -> Layers, FullLayerPaths, LayerColors, Linetypes, MaterialNames, Visible, PrintWidth, PrintColor
r_layerpaths = RemoteSender(layertable.FullLayerPaths)
r_layernames = RemoteSender(layertable.Layers)
python_5 = GhPythonScript(x=in_iv_vis_style_5)  # -> out, a, b
# ---------- python_5: Python ----------
__author__ = "gupta"
__version__ = "2019.10.19"

if x == "gradient":
    a = True
    b = False
else:
    b = True
    a = False
# ---------- end python_5 ----------
hui_dv_valueheight_2 = RemoteReceiver(hui_dv_valueheight)
toggle_2 = BooleanToggle(True)
dom = ConstructDomain(DomainStart=1, DomainEnd=hui_dv_valueheight_2)
hideshow_7 = HideShowObjectPreview(Visible=python_5.a, AllObjects_Object=[boundary, preview])
hideshow_8 = HideShowObjectPreview(Visible=python_5.b, AllObjects_Object=[remap, sort, item_7, item_8, dom_2, dom, Z, extr, boundary_2])

# ----
# Choosing the Independent
# Data Set to be Visualised
r_layerpaths_2 = RemoteReceiver(r_layerpaths)
label_10 = CreateLabel(LabelText="Select the First Dataset", LabelSize=12, Justification=0)
r_layernames_2 = RemoteReceiver(r_layernames)
r_layerpaths_3 = RemoteReceiver(r_layerpaths)

# ---- group: Removing Sublayers
python_6 = GhPythonScript(paths=r_layerpaths_2)  # -> out, names; inputs paths: list
# ---------- python_6: Python ----------
__author__ = "gupta"
__version__ = "2019.10.19"

names = []

for layer in paths:
    if "::" not in layer:
        names.append(layer)
# ---------- end python_6 ----------

# ----
adjustelem = AdjustElementAppearance(ElementsToAdjust=label_10, Foreground=ColourSwatch(SwatchColor=RGB(31, 31, 31)), FontSize=Slider(17, range=0..24))

# ----
# Choosing the Dependent
# Data Set to be Visualised
r_layerpaths_4 = RemoteReceiver(r_layerpaths)
pulldown = CreatePulldownMenu(ListItems="Select dataset", showLabel=True)
label_11 = CreateLabel(LabelText=" ", LabelSize=12, Justification=0)
label_12 = CreateLabel(LabelText="Select the Second Dataset", LabelSize=12, Justification=0)
values_9 = ValueListener(Elements=pulldown, SomeProperty=True)  # -> Values, Indices
in_second_key = RemoteSender(values_9.Values)
merge_10 = Merge(Data1=label_11, Data2=label_12, Data3=pulldown)
r_layernames_3 = RemoteReceiver(r_layernames)
r_layerpaths_5 = RemoteReceiver(r_layerpaths)
graft = GraftTree(Tree=values_9.Values, IncludeEmptyLists=True, IncludeNullItems=True)
adjustelem_2 = AdjustElementAppearance(ElementsToAdjust=label_12, Foreground=ColourSwatch(SwatchColor=RGB(31, 31, 31)), FontSize=Slider(17, range=0..24))
hui_dv_dataset = RemoteSender(merge_10)

# ---- group: dataset to sublayer names
python_7 = GhPythonScript(paths=r_layerpaths_5, names=r_layernames_3, selected=flatten(graft))  # -> out, selected_layers; inputs paths: list, names: list, selected: list
# ---------- python_7: Python ----------
__author__ = "gupta"
__version__ = "2019.10.19"

selected_layers = []

for name in selected:
    for i in range(len(paths)):
        if name in paths[i]:
            selected_layers.append(names[i])
# ---------- end python_7 ----------

# ----
hui_dv_dataset_2 = RemoteReceiver(hui_dv_dataset)

pulldown_2 = CreatePulldownMenu(ListItems=python_6.names, showLabel=True)
values_10 = ValueListener(Elements=pulldown_2, SomeProperty=True)  # -> Values, Indices
merge_11 = Merge(Data1=label_10, Data2=pulldown_2)
in_key = RemoteSender(values_10.Values)
graft_2 = GraftTree(Tree=values_10.Values, IncludeEmptyLists=True, IncludeNullItems=True)
hui_iv_dataset = RemoteSender(merge_11)

in_key_2 = RemoteReceiver(in_key)
i_second_layer_names = RemoteSender(python_7.selected_layers)

# ---- group: Removing Sublayers
python_8 = GhPythonScript(paths=r_layerpaths_4, first_key=in_key_2)  # -> out, names; inputs paths: list
# ---------- python_8: Python ----------
__author__ = "gupta"
__version__ = "2019.10.19"

names = []

for layer in paths:
    if "::" not in layer and first_key not in layer:
        names.append(layer)
# ---------- end python_8 ----------

# ----
setlist = SetListContents(ListToModify=pulldown, NewListContents=python_8.names)

# ---- group: dataset to sublayer names
python_9 = GhPythonScript(paths=r_layerpaths_3, names=r_layernames_2, selected=flatten(graft_2))  # -> out, selected_layers; inputs paths: list, names: list, selected: list; same code as python_7

# ----
i_layer_names = RemoteSender(python_9.selected_layers)

i_layer_names_2 = RemoteReceiver(i_layer_names)
i_second_layer_names_2 = RemoteReceiver(i_second_layer_names)
dpipeline = DynamicGeometryPipeline(
    LayerFilter=flatten(i_layer_names_2),
    TypeFilter="All",
    NameFilter="*",
    GroupByLayer=False,
    GroupByType=False,
    IncludeHidden=True,
    IncludeLocked=True,
    enableFullPath=False,
    listenToAttributes=True)
objatts = ObjectAttributes(ObjectOrAttributes=dpipeline)  # -> Name, LayerName, LayerFullPath, Color, MaterialName, LinetypeName, GroupIndices, PlotWeight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
in_key_3 = RemoteReceiver(in_key)
dpipeline_2 = DynamicGeometryPipeline(
    LayerFilter=flatten(i_second_layer_names_2),
    TypeFilter="All",
    NameFilter="*",
    GroupByLayer=False,
    GroupByType=False,
    IncludeHidden=True,
    IncludeLocked=True,
    enableFullPath=False,
    listenToAttributes=True)
clean = CleanTree(RemoveNulls=toggle, RemoveInvalid=True, RemoveEmpty=toggle, Tree=objatts.UserDataKeys)  # -> simplify(Tree)
clean_2 = CleanTree(RemoveNulls=toggle, RemoveInvalid=True, RemoveEmpty=toggle, Tree=objatts.UserDataValues)  # -> simplify(Tree)
clean_3 = CleanTree(RemoveNulls=toggle, RemoveInvalid=True, RemoveEmpty=toggle, Tree=dpipeline)
objatts_2 = ObjectAttributes(ObjectOrAttributes=dpipeline_2)  # -> Name, LayerName, LayerFullPath, Color, MaterialName, LinetypeName, GroupIndices, PlotWeight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
graft_3 = GraftTree(Tree=clean_3, IncludeEmptyLists=True, IncludeNullItems=True)  # -> simplify(Tree)
in_keys = RemoteSender(clean)
in_keys_2 = RemoteReceiver(in_keys)
in_values = RemoteSender(clean_2)
in_values_2 = RemoteReceiver(in_values)
in_geo = RemoteSender(graft_3)
in_geo_2 = RemoteReceiver(flatten(in_geo))
in_geo_3 = RemoteReceiver(in_geo)
boundary = BoundarySurfaces(Edges=in_geo_2)
boundary_2 = BoundarySurfaces(Edges=in_geo_2)
geometry_and_values = GhPythonScript(dataset=in_key_3, style=in_iv_vis_style_5, keys=in_keys_2, values=in_values_2, geometry=in_geo_3)  # -> out, geom, val; inputs keys: tree, values: tree, geometry: tree
# ---------- geometry_and_values: Python ----------
__author__ = "gupta"
__version__ = "2019.10.19"

geom = []
val = []

for i in range(geometry.BranchCount):
    geom.append(geometry.Branch(i)[0])
    for j in range(len(keys.Branch(i))):
        if keys.Branch(i)[j] == dataset:
            val.append(values.Branch(i)[j])
# ---------- end geometry_and_values ----------
sort = SortList(Keys=geometry_and_values.val)  # -> Keys, ValuesA
sort_2 = SortList(Keys=geometry_and_values.val)  # -> Keys, ValuesA
panel_15 = Panel(in_keys)
panel_16 = Panel(in_geo)
item_7 = ListItem(List=sort.Keys, Index=0, Wrap=True)
item_8 = ListItem(List=sort.Keys, Index=-1, Wrap=True)
item_9 = ListItem(List=sort_2.Keys, Index=0, Wrap=True)
item_10 = ListItem(List=sort_2.Keys, Index=-1, Wrap=True)
clean_4 = CleanTree(RemoveNulls=toggle_2, RemoveInvalid=True, RemoveEmpty=toggle_2, Tree=objatts_2.UserDataKeys)  # -> simplify(Tree)
clean_5 = CleanTree(RemoveNulls=toggle_2, RemoveInvalid=True, RemoveEmpty=toggle_2, Tree=objatts_2.UserDataValues)  # -> simplify(Tree)
clean_6 = CleanTree(RemoveNulls=toggle_2, RemoveInvalid=True, RemoveEmpty=toggle_2, Tree=dpipeline_2)
panel_17 = Panel(clean_5)
dom_2 = ConstructDomain(DomainStart=item_7, DomainEnd=item_8)
graft_4 = GraftTree(Tree=clean_6, IncludeEmptyLists=True, IncludeNullItems=True)  # -> simplify(Tree)
dom_3 = ConstructDomain(DomainStart=item_9, DomainEnd=item_10)
panel_18 = Panel(in_values)
cset = CreateSet(List=flatten(clean_4))  # -> Set, Map
remap = RemapNumbers(Value=geometry_and_values.val, Source=dom_2, Target=dom)  # -> Mapped, Clipped
remap_2 = RemapNumbers(Value=geometry_and_values.val, Source=dom_3, Target=Domain(0, 1))  # -> Mapped, Clipped
in_second_values = RemoteSender(clean_5)
in_second_geo = RemoteSender(graft_4)
in_second_keys = RemoteSender(cset.Set)
remapped_values = RemoteSender(remap_2.Mapped)

gradient_3 = CreateGradientEditor(ShowEditor=True, ShowPresets=False)
connected = GetConnectedObjects(Objects=gradient_3)
item_11 = ListItem(List=flatten(values_2.Values), Index=1, Wrap=True)
values_11 = ValueListener(Elements=gradient_3, SomeProperty=True)  # -> Values, Indices
hideshow_9 = HideShowElement(ElementToHideShow=gradient_3, Show=item_11, Collapse=True, Disable=False)
python_10 = GhPythonScript(x=values_11.Values)  # -> a
# ---------- python_10: Python ----------
a = [i.rstrip() for i in x.split('\r\n') if i.rstrip() != '']
# ---------- end python_10 ----------
split = TextSplit(Text=python_10, Separators=",")
remapped_values_2 = RemoteReceiver(remapped_values)
item_12 = ListItem(List=split, Index=0, Wrap=True)  # -> Item, Item1, Item2, Item3
rgb = ColourRGB(Alpha=item_12.Item, Red=item_12.Item1, Green=item_12.Item2, Blue=item_12.Item3)
range = Range(Domain=Domain(0, 1), Steps=1)
interp = InterpolateData(Data=flatten(rgb), Parameter=remapped_values_2, Interpolation=2)

hui_dv_valgrad = RemoteSender(gradient_3)

connected_2 = GetConnectedObjects()
item_13 = ListItem(List=flatten(values_5.Values), Index=1, Wrap=True)
values_12 = ValueListener(Elements=gradient_2, SomeProperty=True)  # -> Values, Indices
hideshow_10 = HideShowElement(ElementToHideShow=gradient_2, Show=item_13, Collapse=True, Disable=False)
python_11 = GhPythonScript(x=values_12.Values)  # -> a; same code as python_10
split_2 = TextSplit(Text=python_11, Separators=",")
remapped_values_3 = RemoteReceiver(remapped_values)
item_14 = ListItem(List=split_2, Index=0, Wrap=True)  # -> Item, Item1, Item2, Item3
rgb_2 = ColourRGB(Alpha=item_14.Item, Red=item_14.Item1, Green=item_14.Item2, Blue=item_14.Item3)
range_2 = Range(Domain=Domain(0, 1), Steps=1)
interp_2 = InterpolateData(Data=flatten(rgb_2), Parameter=remapped_values_3, Interpolation=2)

hui_dv_valgrad_2 = RemoteReceiver(hui_dv_valgrad)
preview = CustomPreview(Geometry=boundary, Material=interp_2)
boundary_3 = BoundarySurfaces(Edges=clean_6)
Z = UnitZ(Factor=remap.Mapped)
python_12 = GhPythonScript(srf=boundary_3, values=clean_5)  # -> out, a; inputs srf: list of Surface, values: tree; disabled
# ---------- python_12: Python ----------
__author__ = "gupta"
__version__ = "2019.10.19"

import Rhino.Geometry as rg

val = []

for i in range(values.BranchCount):
    val.append(values.Branch(i))

print val

extrusions = []
moved = []

for i in range(len(val)):
    area = rg.AreaMassProperties.Compute(srf[i])
    center = area.Centroid
    for j in range(len(val[i])):
        vector = rg.Vector3d(center, rg.Point3d(center.X, center.Y, center.Z + 10))
        print vector
# ---------- end python_12 ----------
remap_3 = RemapNumbers(Value=clean_5, Source=Domain(0, 100), Target=Domain(0, 255))  # -> Mapped, Clipped
remap_4 = RemapNumbers(Value=clean_5, Source=Domain(0, 100), Target=Domain(0, 1))  # -> Mapped, Clipped
branch = TreeBranch(Tree=simplify(interp_2), Path="{0}", MaintainPaths=True)
extr = Extrude(Base=boundary_2, Direction=Z)  # -> simplify(Extrusion)
graft_5 = GraftTree(Tree=extr, IncludeEmptyLists=True, IncludeNullItems=True)  # -> simplify(Tree)
branch_2 = TreeBranch(Tree=extr, Path="{0}", MaintainPaths=True)
rgb_3 = ColourRGB(Alpha=255, Red=remap_3.Mapped, Green="200", Blue="200")
panel_19 = Panel(extr)
interp_3 = InterpolateData(Data=flatten(rgb_2), Parameter=remap_4.Mapped, Interpolation=2)
preview_2 = CustomPreview(Geometry=branch_2, Material=branch)

hui_iv_datatype_2 = RemoteReceiver(hui_iv_datatype)
hui_iv_dataset_2 = RemoteReceiver(hui_iv_dataset)
hui_header_2 = RemoteReceiver(hui_header)
panel_20 = Panel("""SPARROW
- making complex datasets accessible""")
merge_12 = Merge(
    Data1=flatten(hui_header_2),
    Data2=flatten(hui_iv_dataset_2),
    Data3=flatten(hui_iv_datatype_2),
    Data4=flatten(hui_iv_vizlabel_2),
    Data5=flatten(hui_iv_vizvalue_2),
    Data6=flatten(hui_iv_valueheight_2),
    Data7=flatten(hui_iv_valuegrad_2),
    Data9=flatten(hui_dv_dataset_2),
    Data10=flatten(hui_dv_datatype_2),
    Data11=flatten(hui_dv_vizlabel_2),
    Data12=flatten(hui_dv_vizvalue_2),
    Data13=flatten(hui_dv_vizvdiscrete_2),
    Data15=flatten(hui_dv_valgrad_2))

launchwin = LaunchWindow(Show=Toggle(True), Name=panel_20, Width=370, Height=400, ChildStatus=1, EnableHorizScroll=False)

addelems = AddElements(Window=launchwin, Elements=flatten(merge_12), DoVLChecking=True)  # -> AddedElements, ElementNames
